# Grasshopper definition Branch Count.gh (Grasshopper 1.0.7)
# plug-ins: Jellyfish

series = Series(Start=0, Step=1, Count=10)
partition = PartitionList(List=series, Size=Slider(3, range=0..10))
tstat = TreeStatistics(Tree=partition)  # -> Paths, Length, Count
branchcount = BranchCount(Data=partition)
panel = Panel(tstat.Paths)
panel_2 = Panel(branchcount)
