# Grasshopper definition Center Point.gh (Grasshopper 1.0.7)
# plug-ins: Jellyfish

sph = Sphere(Base=PlaneXY(0, 0, 0), Radius=1)
box = CenterBox(Base=PlaneXY(0, 0, 0), X=1, Y=1, Z=1)
Z = UnitZ(Factor=1)
move = Move(Geometry=box, Motion=Z)  # -> Geometry, Transform
sunion = SolidUnion(Breps=[sph, move.Geometry])
centerpoint = CenterPoint(Geometry=sunion)
