# Grasshopper definition Consecutive Addition.gh (Grasshopper 1.0.7)
# plug-ins: Jellyfish

series = Series(Start=0, Step=1, Count=10)
panel = Panel(series)
consecutiveaddition = ConsecutiveAddition(Numbers=series)
panel_2 = Panel(consecutiveaddition)
