# Grasshopper definition Cull Branch.gh (Grasshopper 1.0.7)
# plug-ins: Jellyfish

series = Series(Start=0, Step=1, Count=10)
partition = PartitionList(List=series, Size=Slider(3, range=0..10))
panel = Panel(partition)
merge = Merge(Data1=Slider(0, range=0..10), Data2=Slider(3, range=0..10))
cull_branch = CullBranch(Data=partition, Indexes=merge)
panel_2 = Panel(cull_branch)
