# Grasshopper definition Format Number.gh (Grasshopper 1.0.7)
# plug-ins: Jellyfish

formatnumber = FormatNumber(Number=Slider(545.684, range=0..1000), Format="0000.0000")
panel = Panel(formatnumber)
