# Grasshopper definition Generic Ungroup.gh (Grasshopper 1.0.7)
# plug-ins: Jellyfish

series = Series(Start=0, Step=1, Count=10)
pt = ConstructPoint(XCoordinate=0, YCoordinate=0, ZCoordinate=0)
merge = Merge(Data1=series, Data2=pt)  # -> flatten(Result)
panel = Panel(merge)
genericgroup = GenericGroup(Data=merge)
genericungroup = GenericUngroup(Group=genericgroup)
panel_2 = Panel(genericgroup)
panel_3 = Panel(genericungroup)
