# Grasshopper definition Hyperbolic Tangent.gh (Grasshopper 1.0.7)
# plug-ins: Jellyfish

pi = Pi(Factor=Slider(2, range=0..10))
neg = Negative(Value=pi)
dom = ConstructDomain(DomainStart=neg, DomainEnd=pi)
range = Range(Domain=dom, Steps=Slider(100, range=0..100))
tanh = HyperbolicTangent(X=range)
pt = ConstructPoint(XCoordinate=range, YCoordinate=tanh, ZCoordinate=0)
intcrv = Interpolate(Vertices=pt, Degree=3, Periodic=False, KnotStyle=1)  # -> Curve, Length, Domain
