# Grasshopper definition Make Pair.gh (Grasshopper 1.0.7)
# plug-ins: Jellyfish

series = Series(Start=0, Step=1, Count=10)
panel = Panel(series)
makepair = MakePair(Data=series, PairNumber=2, Loop=True)
panel_2 = Panel(makepair)
