# Grasshopper definition Point to Text.gh (Grasshopper 1.0.7)
# plug-ins: Jellyfish

sph = Sphere(Base=PlaneXY(0, 0, 0), Radius=1)
popgeo = PopulateGeometry(Geometry=sph, Count=100, Seed=1)
pointtotext = PointToText(Point=popgeo, Delimiter=",")
panel = Panel(pointtotext)
