# Grasshopper definition Random Vector.gh (Grasshopper 1.0.7)
# plug-ins: Jellyfish

pt = ConstructPoint(XCoordinate=0, YCoordinate=0, ZCoordinate=0)
randomvector = RandomVector(Number=Slider(100, range=0..100), Seed=0)
vdis = VectorDisplay(Anchor=pt, Vector=randomvector)
