# Grasshopper definition Remove Duplicate Points With Associates.gh (Grasshopper 1.0.7)
# plug-ins: Jellyfish

sqgrid = Square(Plane=PlaneXY(0, 0, 0), Size=1, ExtentX=5, ExtentY=5)  # -> Cells, Points
explode = Explode(Curve=sqgrid.Cells, Recursive=True)  # -> Segments, Vertices
flatten = FlattenTree(Tree=explode.Vertices, Path="{0}")
lng = ListLength(List=flatten)
sph = Sphere(Base=flatten, Radius=Slider(0.2, range=0..1))
panel = Panel(lng)
removeduplicatepointswithassociates = RemoveDuplicatePointsWithAssociates(Points=flatten, Objects=sph, Threshold=0.01)  # -> Points, Objects, Indexes, RemovedIndexes
lng_2 = ListLength(List=removeduplicatepointswithassociates.Points)
lng_3 = ListLength(List=removeduplicatepointswithassociates.Objects)
panel_2 = Panel(lng_2)
panel_3 = Panel(lng_3)
panel_4 = Panel(removeduplicatepointswithassociates.Indexes)
panel_5 = Panel(removeduplicatepointswithassociates.RemovedIndexes)
