# Grasshopper definition Round Fraction.gh (Grasshopper 1.0.7)
# plug-ins: Jellyfish

roundfraction = RoundFraction(Number=Slider(256.62262, range=0..1000), DecimalIndex=Slider(2, range=0..10))
panel = Panel(roundfraction)
