# Grasshopper definition Save CSV.gh (Grasshopper 1.0.7)
# plug-ins: Jellyfish

sph = Sphere(Base=PlaneXY(0, 0, 0), Radius=1)
popgeo = PopulateGeometry(Geometry=sph, Count=100, Seed=1)
graft = GraftTree(Tree=popgeo, IncludeEmptyLists=True, IncludeNullItems=True)
panel = Panel("""x
y
z""")
pdecon = Deconstruct(Point=graft)  # -> XComponent, YComponent, ZComponent
merge = Merge(Data1=pdecon.XComponent, Data2=pdecon.YComponent, Data3=pdecon.ZComponent)
path = FilePath()
savecsv = SaveCSV(Header=panel, Text=merge, File=path, Separator=",", Save=Toggle(False))
panel_2 = Panel(savecsv)
