# Grasshopper definition Save Text.gh (Grasshopper 1.0.7)
# plug-ins: Jellyfish

panel = Panel("""Hello World
ABCDEFGHI""")
path = FilePath()
savetext = SaveText(Text=panel, File=path, Save=Toggle(False))
