# Grasshopper definition Shuffle List.gh (Grasshopper 1.0.7)
# plug-ins: Jellyfish

series = Series(Start=0, Step=1, Count=10)
panel = Panel(series)
shufflelist = ShuffleList(List=series, Seed=Slider(7, range=0..10))
panel_2 = Panel(shufflelist)
