# Grasshopper definition Split Geometry By Type.gh (Grasshopper 1.0.7)
# plug-ins: Jellyfish

cir = Circle(Plane=PlaneXY(0, 0, 0), Radius=1)
sph = Sphere(Base=PlaneXY(0, 0, 0), Radius=1)
box = CenterBox(Base=PlaneXY(0, 0, 0), X=1, Y=1, Z=1)
mbox = MeshBox(Base={Plane=PlaneXY(0, 0, 0), X=Domain(-10, 10), Y=Domain(-10, 10), Z=Domain(-10, 10)}, XCount=10, YCount=10, ZCount=10)
popgeo = PopulateGeometry(Geometry=cir, Count=100, Seed=1)
merge = Merge(Data1=popgeo, Data2=cir, Data3=sph, Data4=box, Data5=mbox)
splitgeometrybytype = SplitGeometryByType(Geometries=merge)  # -> Points, Curves, Surfaces, Breps, Meshes
panel = Panel(splitgeometrybytype.Points)
panel_2 = Panel(splitgeometrybytype.Curves)
panel_3 = Panel(splitgeometrybytype.Surfaces)
panel_4 = Panel(splitgeometrybytype.Breps)
panel_5 = Panel(splitgeometrybytype.Meshes)
