# Grasshopper definition Time Counter.gh (Grasshopper 1.0.7)
# plug-ins: Jellyfish

timecounter = TimeCounter(Reset=Button(), Start=Toggle(False), TickStep=Slider(1, range=1..100))  # -> Second, Millisecond, Tick
panel = Panel(timecounter.Second)
panel_2 = Panel(timecounter.Millisecond)
panel_3 = Panel(timecounter.Tick)
