# Grasshopper definition Transpose.gh (Grasshopper 1.0.7)
# plug-ins: Jellyfish

planesrf = PlaneSurface(Plane=PlaneXY(0, 0, 0), XSize=Domain(-10, 10), YSize=Domain(-10, 10))
transpose = Transpose(Surface=planesrf)
sdivide = DivideSurface(Surface=planesrf, UCount=10, VCount=10)  # -> Points, Normals, Parameters
sdivide_2 = DivideSurface(Surface=transpose, UCount=10, VCount=10)  # -> Points, Normals, Parameters
filter = StreamFilter(Gate=Slider(1, range=0..1), Stream0=sdivide.Points, Stream1=sdivide_2.Points)
tstat = TreeStatistics(Tree=filter)  # -> Paths, Length, Count
item = ListItem(List=tstat.Paths, Index=0, Wrap=True)
branch = TreeBranch(Tree=filter, Path=item, MaintainPaths=True)
