# Grasshopper definition Tree Branch Index.gh (Grasshopper 1.0.7)
# plug-ins: Jellyfish

series = Series(Start=0, Step=1, Count=10)
graft = GraftTree(Tree=series, IncludeEmptyLists=True, IncludeNullItems=True)
addition = Addition(A=series, B=graft)
panel = Panel(addition)
treebranchindex = TreeBranchIndex(Data=addition, BranchIndex=Slider(2, range=0..10))
panel_2 = Panel(treebranchindex)
