# Grasshopper definition Weighted Populate Geometry.gh (Grasshopper 1.0.7)
# plug-ins: Jellyfish

number_slider = Slider(100, range=0..100)
box = CenterBox(Base=PlaneXY(0, 0, 0), X=number_slider, Y=number_slider, Z=number_slider)
popgeo = PopulateGeometry(Geometry=box, Count=Slider(3, range=0..10), Seed=1)
preview = CustomPreview(Geometry=box, Material=ColourSwatch(SwatchColor=RGBA(92, 231, 255, 209)))
weightedpopulategeometry = WeightedPopulateGeometry(
    Geometry=box,
    NumberOfAttractorPoints=Slider(1000, range=0..1000),
    Iteration=100,
    AttractorPoints=popgeo,
    AttractorRadiuses=number_slider,
    AttractorWeights=Slider(-1, range=-1..1))
